# Grasshopper definition animation_piton.ghx (Grasshopper 1.0.7)

python = GhPythonScript()  # -> Out, A
python_2 = GhPythonScript()  # -> Out, A
python_3 = GhPythonScript()  # -> Out, A
python_4 = GhPythonScript()  # -> Out, A
toggle = BooleanToggle(True)
int = Integer("200")
interval = Domain(int)
timer = Timer(TimerInterval=60, Target=c_script)
id = Guid(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)
c_script = CSharpScript(reset=toggle)  # -> out, B, C, state; inputs reset: Boolean
# ---------- c_script: C# usings ----------
using System.IO;
using System.Linq;
using System.Data;
using System.Drawing;
using System.Reflection;
using System.Windows.Forms;
using System.Xml;
using System.Xml.Linq;
using System.Runtime.InteropServices;

using Rhino.DocObjects;
using Rhino.Collections;
using GH_IO;
using GH_IO.Serialization;
# ---------- c_script: C# ----------
    if(!reset){
      c++;
    }else{
      c = -1;
    }
    c = (int) (c % (201));
    if(c <= 200){
      B = true;
    }else{
      B = false;
    }


    C = c;
    if(!reset)
    {
      state = 1;
    }
    else
    {
      state = 0;
    }
# ---------- c_script: C# additional code ----------
  int c = -1;
# ---------- end c_script ----------
bool = Boolean(toggle)
rec = Rectangle({Plane=PlaneXY(-4.941186692, -4.778192894, 0), Size=Domain2(u=-5.038197191..5.038197191, v=-4.975997225..4.975997225)})
pt = Point(Point(7.386500901, 5.223602847, 0))
python_5 = GhPythonScript(area=rec, counter=c_script.C)  # -> a; inputs counter: Int32
# ---------- python_5: Python ----------
from ghpythonlib.componentbase import executingcomponent as component
import Grasshopper, GhPython
import System
import Rhino as rh
import rhinoscriptsyntax as rs
import scriptcontext as sc
import math
import Rhino.Geometry as rg

STATE_FREE = 0
STATE_BLOCKED = 1

class MyComponent(component):
    
    def __init__(self):
        self.gridSize = 0.1
        self.grids = None
        self.gridInitialized = False
        
    def InitializeGrid(self,area):
        import rhinoscriptsyntax as rs
        
        #get nurbscurve or rectangle
        rectArea = rs.coercecurve(area)
        
        #get width/height of the area and gridCount
        diffW = rectArea.Points[0].Location[0] - rectArea.Points[2].Location[0]
        gridCountW =  int(math.ceil(abs(diffW)/self.gridSize))
        
        diffH = rectArea.Points[0].Location[1] - rectArea.Points[2].Location[1]
        gridCountH =  int(math.ceil(abs(diffH)/self.gridSize))
        
        #initialize grid array
        self.grids = [[STATE_FREE for i in range(gridCountW)]for j in range(gridCountH)]
        
        if rectArea:
            
            #get objects inside the region
            rc,pl = rectArea.TryGetPolyline()
            view = sc.doc.Views.ActiveView.ActiveViewport            
            objectList = rh.RhinoDoc.ActiveDoc.Objects.FindByCrossingWindowRegion(view,pl,True,rh.DocObjects.ObjectType.Curve)
            
            for oi in objectList:
                for i in range(len(self.grids)):
                    for j in range(len(self.grids[i])):
                        #rg.Rectangle3d.
                        cRect = rh.Geometry.Rectangle3d(rh.Geometry.Plane.WorldXY,rg.Point3d(rectArea.Points[0].Location[0]+(j*self.gridSize),rectArea.Points[0].Location[0]+(i*self.gridSize),0),rg.Point3d(rectArea.Points[0].Location[0]+((j+1)*self.gridSize),rectArea.Points[0].Location[0]+((i+1)*self.gridSize),0))
                        #print cRect.Area
                        inter = rg.Intersect.Intersection.CurveCurve(oi.CurveGeometry,cRect.ToNurbsCurve(),0.1,0)
                        if inter:
                            self.grids[i][j] = 2
        for i in range(len(self.grids)):
                print self.grids[i]
        self.gridInitialized = True
    
    def RunScript(self, area,counter):
        a = None
        """Provides a scripting component.
            Inputs:
                x: The x script variable
                y: The y script variable
            Output:
                a: The a output variable"""
        
        __author__ = "andri.setiawan"
        __version__ = "2020.03.16"
        
        import rhinoscriptsyntax as rs
        
        if not self.gridInitialized:
            self.InitializeGrid(area)
        
        """
        rectArea = rs.coercecurve(area)
        
        #gridDim1 = rectArea.Points[0][0] - rectArea.Points[2][0]
        
        #dd = rh.Geometry.ControlPoint.Location.
        diffW = rectArea.Points[0].Location[0] - rectArea.Points[2].Location[0]
        gridCountW =  int(math.ceil(abs(diffW)/self.gridSize))
        
        diffH = rectArea.Points[0].Location[1] - rectArea.Points[2].Location[1]
        gridCountH =  int(math.ceil(abs(diffH)/self.gridSize))
        
        
        print("grid count %d %d"%(gridCountW,gridCountH))
        
        self.grids = [[STATE_FREE for i in range(gridCountW)]for j in range(gridCountH)]
        
        if rectArea:
            rc,pl = rectArea.TryGetPolyline()
            view = sc.doc.Views.ActiveView.ActiveViewport
            
            objectList = rh.RhinoDoc.ActiveDoc.Objects.FindByCrossingWindowRegion(view,pl,True,rh.DocObjects.ObjectType.Curve)
            i = 0
            for oi in objectList:
                print "ojepk %d gu %s is %s" %(i,oi, oi.GetType())
                #rh.DocObjects.CurveObject.
                print oi.CurveGeometry
                objj  = oi.CurveGeometry.GetType()
                
                #rh.Geometry.Rectangle3d(
                
                #if objj == rh.Geometry.LineCurve:
                    #print oi.CurveGeometry.PointAtStart
                    #print oi.CurveGeometry.PointAtEnd
                    #for i in range(len(self.grids)):
                        #for j in range(len(self.grids[i])):
                            #rg.Rectangle3d.
                            #cRect = rh.Geometry.Rectangle3d(rh.Geometry.Plane.WorldXY,rg.Point3d(rectArea.Points[0].Location[0]+(i*self.gridSize),rectArea.Points[0].Location[0]+(j*self.gridSize),0),rg.Point3d(rectArea.Points[0].Location[0]+((i+1)*self.gridSize),rectArea.Points[0].Location[0]+((j+1)*self.gridSize),0))
                            #print cRect.Area
                            #inter = rg.Intersect.Intersection.CurveCurve(oi.CurveGeometry,cRect.ToNurbsCurve(),0.1,0)
                            #if inter:
                                #self.grids[i][j] = STATE_BLOCKED
                        #print self.grids[i]
                #else:
                    #obb=oi.CurveGeometry.Points
                    #for po in obb:
                        #print po.Location
                for i in range(len(self.grids)):
                    for j in range(len(self.grids[i])):
                        #rg.Rectangle3d.
                        cRect = rh.Geometry.Rectangle3d(rh.Geometry.Plane.WorldXY,rg.Point3d(rectArea.Points[0].Location[0]+(i*self.gridSize),rectArea.Points[0].Location[0]+(j*self.gridSize),0),rg.Point3d(rectArea.Points[0].Location[0]+((i+1)*self.gridSize),rectArea.Points[0].Location[0]+((j+1)*self.gridSize),0))
                        #print cRect.Area
                        inter = rg.Intersect.Intersection.CurveCurve(oi.CurveGeometry,cRect.ToNurbsCurve(),0.1,0)
                        if inter:
                            self.grids[i][j] = STATE_BLOCKED
                #print obb
                #crv = rs.coercecurve(oi.Id)
                #print crv
                #if crv:
                    #print crv.GetType()
                #print od
                i+=1
            for i in range(len(self.grids)):
                print self.grids[i]
        """
        # return outputs if you have them; here I try it for you:
        a = self.grids
        return a
# ---------- end python_5 ----------
python_6 = GhPythonScript(initial=pt, active=bool, x=c_script.C, id=id)  # -> a; inputs initial: Point3d, active: Boolean, x: Int32, id: Guid
# ---------- python_6: Python ----------
from ghpythonlib.componentbase import executingcomponent as component
import Grasshopper, GhPython
import System
import Rhino as rh
import rhinoscriptsyntax as rs
from Rhino.Geometry import Point3d, Vector3d,Point3f,Vector3f
import random


class MyComponent(component):
    initiated = None
    myPos = None
    speed = 1
    destination = None
    counter = 0
    
    moveDir = None
    destReached = None
    
    curWaitFrame = None
    initialX = 0
    initialY = 0
    initialZ = 0
    
    def __init__(self):
        self.initiated = False
        self.myPos = Point3f(0,0,0)
        self.destination = Point3f(0,0,0)
        self.moveDir = Vector3f(0,0,0)
        self.destReached = True
        self.curWaitFrame = 0
        self.initialX = 0
        self.initialY = 0
        self.initialZ = 0
    
    def RunScript(self, initial, active, x, id):
        a = None
        """Provides a scripting component.
            Inputs:
                x: The x script variable
                y: The y script variable
            Output:
                a: The a output variable"""
        
        __author__ = "andri.setiawan"
        __version__ = "2020.03.13"
        
        import rhinoscriptsyntax as rs
        import scriptcontext as sc
        
        print id
        #initialP = rs.coerce3dpoint(id)
        rh.RhinoDoc.ActiveDoc.Objects.Hide(id, True)
        #print initialP
        if (not self.initiated) or (active):
            if not self.initiated:
                #print initialP
                self.initialX = initial.X
                self.initialY = initial.Y
                self.initialZ = initial.Z
                self.initiated = True
                #rs.DeleteObject(initial)
            #print ("counter %d in %s r %s" %(self.counter,self.initiated,active))
            self.counter+=1
            self.myPos.X = self.initialX
            self.myPos.Y = self.initialY
            self.myPos.Z = self.initialZ
            self.destReached = True
        else:
            if self.destReached:
                if self.curWaitFrame < 20:
                    self.curWaitFrame += 1
                else:
                    self.curWaitFrame = 0
                    self.makeNewDestination()
                    print ("new destination %d %d %d "%(self.destination.X,self.destination.Y,self.destination.Y))
            else:
                distance = self.myPos.DistanceTo(self.destination)
                if distance > 1:
                    self.myPos = rs.PointAdd(self.myPos,self.moveDir)
                else:
                    self.myPos = self.destination
                    self.destReached  = True
        print ("pn %d %d %d %d" %(self.myPos.X,self.myPos.Y,self.myPos.Z,x))
        print ("modir %d %d %d %d" %(self.moveDir.X,self.moveDir.Y,self.moveDir.Z,x))
        print ("destination %d %d %d "%(self.destination.X,self.destination.Y,self.destination.Y))
                        
                        
                
        a = self.myPos
        #initialP.X = self.myPos.X
        #initialP.Y = self.myPos.Y
        #initialP.Z = self.myPos.Z
        
        # return outputs if you have them; here I try it for you:
        return a

    def makeNewDestination(self):
        from Rhino.Geometry import Point3d, Vector3d,Point3f,Vector3f
        import random
        self.destination = Point3f(random.randint(-100,100),random.randint(-100,100),random.randint(-100,100))
        
        self.moveDir = Vector3f.Subtract(Vector3f(self.destination.X,self.destination.Y,self.destination.Z),Vector3f(self.myPos.X,self.myPos.Y,self.myPos.Z))
        #length = Vector3d.Divide(
        self.moveDir = Vector3f.Divide(self.moveDir,self.moveDir.Length)
        self.destReached = False
# ---------- end python_6 ----------
python_7 = GhPythonScript()  # -> a; inputs mArea: list, agent: list
# ---------- python_7: Python ----------
from ghpythonlib.componentbase import executingcomponent as component
import Grasshopper, GhPython
import System
import Rhino
import rhinoscriptsyntax as rs

class MyComponent(component):
    
    def RunScript(self, mArea, agent):
        a = None
        """Provides a scripting component.
            Inputs:
                x: The x script variable
                y: The y script variable
            Output:
                a: The a output variable"""
        
        __author__ = "andri.setiawan"
        __version__ = "2020.03.21"
        
        import rhinoscriptsyntax as rs
        
        for i in range(len(mArea)):
            print mArea[i]
        
        # return outputs if you have them; here I try it for you:
        return a
# ---------- end python_7 ----------
